# Dynamo graph EnergyAnalysisForDynamo_ex6_SetAzimuthAndAltitude.dyn (Dynamo 0.7.2.2921)

azimuth = DoubleSlider(154.8057554, range=0..360)
altitude = DoubleSlider(31.07913669, range=0..90)
setAzimuthAltitude = EnergyAnalysisForDynamo.SolarSettings.SetAzimuthAltitude(azimuth, altitude)
